# Grasshopper definition BrepTest.ghx (Grasshopper 1.0.7)
# plug-ins: Speckle 2, MeshEdit Components

number_slider = Slider(3, range=0..10)
number_slider_2 = Slider(0.4, range=0..1)
number_slider_3 = Slider(2, range=0..10)
range = Range(Domain="-2 to 2", Steps=number_slider)
pt = Point(Point(0, 0, 0))
pt_2 = Point(Point(-0.2375516705, 0.07208809119, -0.2489613433))
pt_3 = Point(Point(0.7966847394, 0.07208809119, 0.135139581))
pt_4 = Point(Point(0.7966847394, 0.07208809119, 1.252480454))
pt_5 = ConstructPoint(XCoordinate=graft(range), YCoordinate=range, ZCoordinate=0)
cyl = Cylinder(Base=pt, Radius=0.5, Length=Slider(1, range=0..10))
box = CenterBox(Base=pt_4, X=number_slider_2, Y=number_slider_2, Z=number_slider_3)
box_2 = CenterBox(Base=pt_3, X=number_slider_3, Y=number_slider_2, Z=number_slider_2)
box_3 = CenterBox(Base=pt_2, X=number_slider_2, Y=number_slider_3, Z=number_slider_2)
box_4 = CenterBox(Base=PlaneXY(0, 0, 0), X=1, Y=1, Z=1)
cap = CapHoles(Brep=cyl)
brep = Brep(box_4)
pt_6 = Point(Tree({0;0;0}: [Point(-2, -2, 0), Point(-2, -0.6666666667, 0), Point(-2, 0.6666666667, 0), Point(-2, 2, 0)], {0;0;1}: [Point(-0.6666666667, -2, 0), Point(-0.6666666667, -0.6666666667, -1.468956097), Point(-0.6666666667, 0.6666666667, 1.305453651), Point(-0.6666666667, 2, -0.9238310205)], {0;0;2}: [Point(0.6666666667, -2, 0), Point(0.6666666667, -0.6666666667, 2.759774879), Point(0.6666666667, 0.6666666667, -0.1358726263), Point(0.6666666667, 2, 0)], {0;0;3}: [Point(2, -2, -1.643371203), Point(2, -0.6666666667, 0), Point(2, 0.6666666667, 0), Point(2, 2, 0)]))
pt_7 = Point(Tree({0;0;0}: [Point(-2, 0, -2), Point(-2, 0, -0.6666666667), Point(-2, -1.157601878, 0.6666666667), Point(-2, -1.531644715, 2)], {0;0;1}: [Point(-0.6666666667, 0, -2), Point(-0.6666666667, -0.339197191, -0.6666666667), Point(-0.6666666667, 2.598013607, 0.6666666667), Point(-0.6666666667, 0, 2)], {0;0;2}: [Point(0.6666666667, -1.084035409, -2), Point(0.6666666667, 0.2769907449, -0.6666666667), Point(0.2187878199, -0.6758975856, 0.6666666667), Point(0.6666666667, -0.9859577286, 2)], {0;0;3}: [Point(2, 0, -2), Point(2, 2.242105939, -0.6666666667), Point(2, 0, 0.6666666667), Point(2, 0, 2)]))
relay = Relay([box, box_2, box_3])
srfgrid = SurfaceFromPoints(Points=flatten(pt_6), UCount=expr("x+1", number_slider), Interpolate=False)
srfgrid_2 = SurfaceFromPoints(Points=flatten(pt_7), UCount=expr("x+1", number_slider), Interpolate=invert(True))
Z = UnitZ(Factor=Slider(-0.6682, range=-1..1))
move = Move(Geometry=srfgrid, Motion=Z)  # -> Geometry, Transform
relay_2 = Relay([move.Geometry, srfgrid_2])
sdiff = SolidDifference(BrepsA=brep, BrepsB=cap)
sdiff_2 = SolidDifference(BrepsA=brep, BrepsB=relay)
sdiff_3 = SolidDifference(BrepsA=brep, BrepsB=box_3)
sdiff_4 = SolidDifference(BrepsA=sdiff_2, BrepsB=relay_2)
sunion = SolidUnion(Breps=[srfgrid, srfgrid_2])
pt_8 = Point([Point(-7.817333337, -6.253343826, 0), Point(-10.02456968, 4.172836202, 1.830920992), Point(10.16226121, 8.408412446, 0), Point(8.777132862, -4.740103994, 0), Point(28.25383308, -7.153124511, 0), Point(27.50993698, 8.01810969, 0)])
item = ListItem(List=pt_8, Index=0, Wrap=True)  # -> Item, Item1, Item2, Item3, Item4, Item5
srf4pt = _4PointSurface(CornerA=item.Item, CornerB=item.Item1, CornerC=item.Item2, CornerD=item.Item3)
srf4pt_2 = _4PointSurface(CornerA=item.Item3, CornerB=item.Item2, CornerC=item.Item5, CornerD=item.Item4)
join = BrepJoin(Breps=[srf4pt, srf4pt_2])  # -> Breps, Closed

msphereex = MeshSphereEx(Base=PlaneXY(0, 0, 0), Radius=10, Count=5)
explode = MeshExplode(Mesh=msphereex, Interpolate=False)
split = SplitList(List=explode, Index=Slider(100, range=0..100))  # -> ListA, ListB
demesh = DeconstructMesh(Mesh=split.ListA)  # -> Vertices, Faces, Colours, Normals
item_2 = ListItem(List=demesh.Vertices, Index=0, Wrap=True)  # -> Item, Item1, Item2, Item3, Item4
srf4pt_3 = _4PointSurface(CornerA=item_2.Item, CornerB=item_2.Item1, CornerC=item_2.Item2, CornerD=item_2.Item3)
join_2 = BrepJoin(Breps=flatten(srf4pt_3))  # -> Breps, Closed

md_slider = MDSlider(
    SliderMode=0,
    slider_value=Point(0.04854523189, 0.9682475765, 0.5),
    x_domain=Domain(0, 1),
    y_domain=Domain(0, 1),
    z_domain=Domain(0, 1))
evalsrf = EvaluateSurface(Surface=reparameterize(srfgrid_2), Point=md_slider)  # -> Point, Normal, UDirection, VDirection, Frame
box_5 = CenterBox(Base=evalsrf.Frame, X=1, Y=1, Z=1)
split_2 = SplitBrep(Brep=srfgrid_2, Cutter=box_5)
item_3 = ListItem(List=split_2, Index=0, Wrap=True)

pt_9 = Point(Point(0.6442965029, -0.01086970551, 0))
pt_10 = Point([Point(6.933961729, -3.869629055, 0), Point(1.136003693, -4.208899822, 0), Point(-1.896360791, 0.3341178344, 0), Point(1.091799117, 4.477686545, 0), Point(5.849853553, 4.470350256, 0), Point(6.017103486, -0.02678989034, 0)])
pline = PolyLine(Vertices=pt_10, Closed=invert(False))
pt_11 = Point(Point(20.57298753, 0, 0))
box_6 = CenterBox(Base=pt_9, X=1, Y=1, Z=1)
cir = Circle(Plane=pt_11, Radius=Slider(5, range=0..10))
pt_12 = Point(Point(1, 1, 1))
pt_13 = Point(Point(0, 0, 0))
split_3 = SplitBrep(Brep=join.Breps, Cutter=box_6)
srfsplit = SurfaceSplit(Surface=srf4pt, Curves=pline)
box_7 = Box2Pt(PointA=pt_13, PointB=pt_12, Plane=PlaneXY(0, 0, 0))
srfsplit_2 = SurfaceSplit(Surface=srf4pt_2, Curves=cir)
item_4 = ListItem(List=srfsplit, Index=0, Wrap=True)  # -> Item, Item1
item_5 = ListItem(List=split_3, Index=0, Wrap=True)
item_6 = ListItem(List=srfsplit_2, Index=0, Wrap=True)  # -> Item, Item1
brep_2 = Brep(box_7)
brep_3 = Brep([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])
panel = Panel("""Cube
CubeWithHole
Complex
FaceWithHole
TrimmedFace
TrimmedFaceSingleLoop
TwoFaces
TwoFacesWithHole
QuadDome
NurbsWithHole""")
concat = Concatenate(FragmentA="Brep-", FragmentB=panel)  # -> graft(Result)

brep_4 = Brep(item_6.Item1)
debrep = DeconstructBrep(Brep=brep_4)  # -> Faces, Edges, Vertices
pt_14 = Point(Point(0.5, 0.5, 0))
evalsrf_2 = EvaluateSurface(Surface=reparameterize(debrep.Faces), Point=pt_14)  # -> flatten(Point), Normal, UDirection, VDirection, Frame
curvepoint = PointOnCurve(debrep.Edges, parameter=0.5)
end = EndPoints(Curve=debrep.Edges)  # -> Start, End
subtraction = Subtraction(A=end.End, B=end.Start)
lng = ListLength(List=evalsrf_2.Point)
lng_2 = ListLength(List=curvepoint)
series = Series(Start=0, Step=1, Count=lng)
series_2 = Series(Start=0, Step=1, Count=lng_2)
tag = TextTag(Location=curvepoint, Text=series_2, Colour=ColourSwatch(SwatchColor=RGB(0, 80, 199)))
vdis = VectorDisplay(Anchor=end.Start, Vector=subtraction)
tag_2 = TextTag(Location=evalsrf_2.Point, Text=series, Colour=ColourSwatch(SwatchColor=RGB(0, 0, 0)))

# ---- group: Serialize/Deserialize
to_speckle = ToSpeckle(Objects=item_6.Item1, KitName="Objects")
srl = Serialize(O=to_speckle)
deserialize = Deserialize(O=srl)
to_native = ToNative(Objects=deserialize, KitName="Objects")
brep_5 = Brep(to_native)
preview = CustomPreview(Geometry=brep_5, Material=ColourSwatch(SwatchColor=RGB(181, 228, 255)))

# ----
path = FilePath("Y:\Documents\Speckle\speckle-sharp\Objects\Converters\ConverterRevit\TestModels\")

number_slider_4 = Slider(1, range=0..1)
srf = Surface(reparameterize(srfgrid_2))
pt_15 = Point([Point(0.2304264784, 0.1245065727, 0), Point(0.1174252386, 0.5301330901, 0), Point(0.4398833213, 0.8202184117, 0), Point(0.8470526571, 0.4339624696, 0), Point(0.7045404598, 0.1754018585, 0)])
rectangle = Rectangle(Plane=PlaneXY(0, 0, 0), XSize=number_slider_4, YSize=number_slider_4, Radius=0)  # -> Rectangle, Length
pline_2 = PolyLine(Vertices=pt_15, Closed=invert(False))
srf_2 = Surface(reparameterize(rectangle.Rectangle))
nurbs = NurbsCurve(Vertices=pt_15, Degree=3, Periodic=invert(False))  # -> Curve, Length, Domain
explode_2 = Explode(Curve=pline_2, Recursive=True)  # -> Segments, Vertices
map_srf = MapToSurface(Curve=nurbs.Curve, Source=srf_2, Target=srf)
panel_2 = Panel("""0.5
1""")

pull = PullCurve(Curve=map_srf, Surface=srf)

shatter = Shatter(Curve=reparameterize(pull), Parameters=panel_2)
srfsplit_3 = SurfaceSplit(Surface=srf, Curves=shatter)
item_7 = ListItem(List=srfsplit_3, Index=0, Wrap=True)  # -> Item, Item1

entwine = Entwine(
    Branch00=brep_2,
    Branch01=sdiff_3,
    Branch02=sdiff_2,
    Branch03=item_6.Item,
    Branch04=item_7.Item1,
    Branch05=item_6.Item1,
    Branch06=join.Breps,
    Branch07=item_5,
    Branch08=join_2.Breps,
    Branch09=item_7.Item,
    FlattenInputs=True)
c_script = CSharpScript(x=item_7.Item1)  # -> out, A; inputs x: Brep
# ---------- c_script: C# ----------
    x.Repair(0.0001);
    A = x;
# ---------- end c_script ----------

to_speckle_2 = ToSpeckle(Objects=entwine, KitName="Objects")
srl_2 = Serialize(O=to_speckle_2)

c_script_2 = CSharpScript(contents=srl_2, folderPath=path, fileName=concat)  # -> A; inputs contents: String, folderPath: String, fileName: String
# ---------- c_script_2: C# ----------
    System.IO.File.WriteAllText(folderPath + fileName + ".json", contents);
# ---------- end c_script_2 ----------
