# Grasshopper definition ExtendObjectTest.ghx (Grasshopper 1.0.7)
# plug-ins: Speckle 2

list = Accounts(
    {"Account (alan@rynne.es | http://localhost:3000)": "c17e3b5af2f177869a733cca10850355"}, selected="Account (alan@rynne.es | http://localhost:3000)",
    selectedId="c17e3b5af2f177869a733cca10850355",
    selectedServer="http://localhost:3000")
sph = Sphere(Base=PlaneXY(0, 0, 0), Radius=1)
repeat = RepeatData(Data=sph, Length=Slider(100, range=0..100))
entwine = Entwine(Branch00=repeat, FlattenInputs=True)
cso = CreateSpeckleObject(A="/Original", B="/Original", C="/Original")  # -> Debug, SpeckleObject
slist = StreamList(Account=list, Limit=10)
id_9abc86882e = CreateStream(Account=list, stream="9abc86882e http://localhost:3000 c17e3b5af2f177869a733cca10850355")
eso = ExtendSpeckleObject(SpeckleObject=cso.SpeckleObject, Keys="ABBC", Values="ABBC")
sup = StreamUpdate(Stream=id_9abc86882e, Name="asdfas", Description="desc", Public=Toggle(True))
create_object_by_key_value = CreateObjectByKeyValue(Keys="ABBC", Values=entwine)
sget = StreamGet(StreamID=sup, Account=list)
send = Send(
    Data=create_object_by_key_value,
    Stream=id_9abc86882e,
    Branch="main",
    AutoSend=False,
    BaseId="8bc95c4a8861830396eb7f8ef8efc109",
    CurrentComponentState="expired",
    OutputWrappers="http://localhost:3000\t9abc86882e\t8d1c2b0e98",
    UseDefaultCache=True)  # -> Commits, ObjectId, Data
sb = SpeckleBase(graft(create_object_by_key_value))
sdet = StreamDetails(StreamID=sget)  # -> StreamID, Name, Description, CreatedAt, UpdatedAt, Public, Collaborators, Branches
receive = Receive(
    ID=send.Commits,
    AutoReceive=False,
    CurrentComponentState="up_to_date",
    LastInfoMessage="Alan Rynne @ 2020-10-23T13:50:55.095Z: Grasshopper push. (id:fb3cc79a43)",
    ReceivedObjectId="74a3d234e04213337f44f9d2bb232126",
    StreamWrapper="http://localhost:3000/streams/9abc86882e/commits/8d1c2b0e98?u=c17e3b5af2f177869a733cca10850355")  # -> Data, Info
panel = Panel(sb)
panel_2 = Panel([sdet.Name, sdet.Description, sdet.Public])
eso_2 = ExpandSpeckleObject(SpeckleObject=receive.Data)
